# Grasshopper definition Exhibition ready before i fuck something up - 35 width circle max.gh (Grasshopper 1.0.5)
# plug-ins: Heteroptera

# 1
# 40
# 
# Works well if it was random for each layer but the generations in the low end gets
# squashed when all layers are the same.
panel = Panel("1-100")
panel_2 = Panel("Maybe 6 as max?")
dom = ConstructDomain(DomainStart="100", DomainEnd="100")
timer = Timer(TimerInterval=1000, Target=[seed_2, seed])  # disabled
panel_3 = Panel("4-7")
seed = SeedGenerator(Number=1)
random = Random(Range=dom, Number=1, Seed=seed)
rec = Rectangle({Plane=PlaneXY(0, 0, 0), Size=Domain2(u=-70..70, v=-70..70)})
panel_4 = Panel("""-221
-481

//closeup""")

# ----
# Middle point for static camera target
pt = Point(Point(490, -70, 0))

panel_5 = Panel("""LL = 40
-123
-390

Closeup""")

# ----
# Control X
# // Element allow for static camera view
# (Currently not implemented)
number_slider = Slider(329.56, range=-3000..3000)
pdecon = Deconstruct()  # -> XComponent, YComponent, ZComponent
# LL = 20
# -109
# -224
# 
# works well with shifted view * 2
X = UnitX(Factor=number_slider)
pt_2 = ConstructPoint(XCoordinate=X, YCoordinate=pdecon.YComponent, ZCoordinate=pdecon.ZComponent)

panel_6 = Panel("2")
camera = CameraCrane(Refresh=True)  # -> Camera, Target, Lens, Up, HorizontalViewAngle, VerticalViewAngle, ScreenRatio

colour = ColourPicker(PickedColour=RGB(255, 0, 247))

# ----
# Distance between circles
# - Random value from seed generator
# 
# Backlog
# - Each objects gets the same distance between all items.
#  Ideally the distance within each object would also be random
panel_7 = Panel("1")
panel_8 = Panel(random)
dom_2 = ConstructDomain(DomainStart="4", DomainEnd="7")
dom_3 = ConstructDomain(DomainStart=panel_7, DomainEnd=panel_8)
random_2 = Random(Range=dom_2, Number=1, Seed=seed)
random_3 = Random(Range=dom_3, Number=random_2, Seed=seed)
number_slider_2 = Slider(6, range=0..20)

panel_9 = Panel(random_2)
ins = InsertItems(List=random_3, Item="0.0", Indices=0, Wrap=True)

# ----
# Circle Contructor
# //Contructs circle from points
seed_2 = SeedGenerator(Number=1)
panel_10 = Panel("""current = 20-4015
40

works well""")
dom_4 = ConstructDomain(DomainStart="15", DomainEnd="35")
random_4 = Random(Range=dom_4, Number=random_2, Seed=seed_2)

# ----
# Basepoint
# - Shifts base point up to allow for base
number_slider_3 = Slider(2, range=0..100)
pt_3 = Point(Point(0, 0, 0))

Z = UnitZ(Factor=number_slider_3)

move = Move(Geometry=pt_3, Motion=Z)  # -> Geometry, Transform

sort = SortList(Keys=ins)  # -> Keys, ValuesA
Z_2 = UnitZ(Factor=sort.Keys)
move_2 = Move(Geometry=move.Geometry, Motion=Z_2)  # -> Geometry, Transform

cir = Circle(Plane=move_2.Geometry, Radius=random_4)

# ----
# *Basemaker*
# //Ensures that every model has a base
# - Extract first circle
# - Make 80% circle at base
# - Insert circle
# 
# *Backlog*
# - % value could be random with
#   domain of max 80% and a min x
panel_11 = Panel("0.9")
split = SplitList(List=cir, Index=1)  # -> ListA, ListB
fragment = TextFragment(Text=split.ListA, Start=9, Count=5)
multiplication = Multiplication(A=fragment, B=panel_11)
cir_2 = Circle(Plane=PlaneXY(0, 0, 0), Radius=multiplication)
ins_2 = InsertItems(List=cir, Item=cir_2, Indices=0, Wrap=True)

divide = DivideCurve(Curve=ins_2, Count="1", Kinks=False)  # -> Points, Tangents, Parameters

# ----
# Alle kurve-typer tegnes
# (flere typer kan tilføjes)
intcrv_t = InterpolateT(Vertices=flatten(divide.Points), Degree=3, TangentStart=Vector(0, 0, 0), TangentEnd=Vector(0, 0, 0), KnotStyle=1)  # -> Curve, Length, Domain
pline = PolyLine(Vertices=flatten(divide.Points), Closed=False)

crv_cp = CurveClosestPoint(Point=flatten(divide.Points), Curve=intcrv_t.Curve)  # -> Point, Parameter, Distance
shatter = Shatter(Curve=intcrv_t.Curve, Parameters=crv_cp.Parameter)
panel_12 = Panel(shatter)

crv_cp_2 = CurveClosestPoint(Point=divide.Points, Curve=pline)  # -> Point, Parameter, Distance
shatter_2 = Shatter(Curve=pline, Parameters=flatten(crv_cp_2.Parameter))
panel_13 = Panel(shatter_2)

# ----
# Der laves et random pattern,
# som bruges til at frasortere nogen af kurverne,
# så der aldrig ligger både en lige og en interpolate kurve oven i hinanden
# 
# Random pattern for validating that a straight and interpolate curve never overlaps
panel_14 = Panel("1")
subtraction = Subtraction(A=random_2, B=panel_14)
dom_5 = ConstructDomain(DomainStart="0", DomainEnd="100")
random_5 = Random(Range=dom_5, Number=subtraction, Seed=2)
panel_15 = Panel(random_5)
smaller = SmallerThan(FirstNumber=random_5, SecondNumber="50")  # -> SmallerThan, OrEqualTo
larger = LargerThan(FirstNumber=random_5, SecondNumber="50")  # -> LargerThan, OrEqualTo
cull = CullPattern(List=flatten(shatter_2), CullPattern=larger.OrEqualTo)
cull_2 = CullPattern(List=flatten(shatter), CullPattern=smaller.SmallerThan)

pt_4 = Point(move.Geometry)

# ----
# Revolve curves and create surfaces
arrpolar = PolarArray(Geometry=[cull_2, cull], Plane=pt_4, Count=10, Angle=6.283185307)  # -> Geometry, Transform
loft = Loft(Curves=arrpolar.Geometry, Options={Adjust=True, Closed=True, LoftEnds=0, LoftSimp=0, LoftType=0, Rebuild=10, Refit=0.01})
join = BrepJoin(Breps=loft)  # -> Breps, Closed
cap = CapHoles(Brep=join.Breps)

ovulate = Ovulate(Geometrical=cap, Boundary=rec, Control=2)  # -> Vector, Number, Rectangle

# ----
# Shift camera target backwards
# 1 * = 1 row
number_slider_4 = Slider(140, range=0..1000)
multiplication_2 = Multiplication(A=number_slider_4, B=Slider(4, range=0..30))
pt_5 = Point(ovulate.Vector)
panel_16 = Panel(multiplication_2)
Y = UnitY(Factor=panel_16)
subtraction_2 = Subtraction(A=pt_5, B=Y)

# ----
# Camera Calculator
number_slider_5 = Slider(-109, range=-500..0)
Y_2 = UnitY(Factor=Slider(-224, range=-3000..3000))
Z_3 = UnitZ(Factor=number_slider_5)
subtraction_3 = Subtraction(A=ovulate.Vector, B=Y_2)
subtraction_4 = Subtraction(A=subtraction_3, B=Z_3)

# ----
# Capture frame
capture = Capture(
    Activate=ovulate.Rectangle,
    Path="C:\Users\sanda\Desktop\vases\Kalle edit\Animation",
    Filename="Capture",
    Ext=0,
    Reset=False)
panel_17 = Panel(capture)

camera_2 = CameraCrane(Location=subtraction_4, Target=subtraction_2, Lense=20, Refresh=True)  # -> Camera, Target, Lens, Up, HorizontalViewAngle, VerticalViewAngle, ScreenRatio

Y_3 = UnitY(Factor="-50")

Y_4 = UnitY(Factor="-50")
X_2 = UnitX(Factor="-50")

subtraction_5 = Subtraction(A=ovulate.Vector, B=Y_4)

# ----
# Text Generator
panel_18 = Panel("Day ")
panel_19 = Panel(ovulate.Number)
ins_3 = InsertItems(List=panel_18, Item=panel_19, Indices=1, Wrap=True)
join_2 = TextJoin(Text=ins_3)
panel_20 = Panel(join_2)
textbaker = TextBaker(Location=subtraction_5, Text=panel_20, Size=Slider(13.349, range=0..100), Color=colour, Justification=7, Activate=True)

panel_21 = Panel(subtraction_5)
pt_6 = Point(panel_21)
txt = Text(panel_20)
